# Dynamo graph Dokaznica_iskopa.dyn (Dynamo 2.10.1.3976)
# Dokaznica količina iskopa po poprečnim profilima (A3 lejauti + rekapitulacija)

ime_osovine_prazno_izbor_u = StringInput("")  # "Ime osovine (prazno = izbor u crtežu)"; graph input
dokaznica_iskopa = Python(IN[0]=ime_osovine_prazno_izbor_u)  # CPython3
# ---------- dokaznica_iskopa.python (1402 lines) ----------
# -*- coding: utf-8 -*-
"""
DOKAZNICA KOLIČINA ISKOPA  -  Civil 3D 2022 / Dynamo (Python Script node)

Šta radi:
  1. Traži od korisnika da izabere osovinu (alignment) u crtežu
     (ili uzima ime osovine sa ulaza IN[0]), otvara dijalog (stil prikaza,
     set traka, lista materijala - postojeća ili nova, boja materijala),
     pa traži tačku umetanja za nove prikaze poprečnih preseka.
  2. Čita grupu poprečnih preseka (sample line group) i listu materijala
     (QTO material list) te osovine.
  3. Za svaki presek očitava površinu materijala i računa zapreminu
     metodom srednjih površina:  V = (A1 + A2) / 2 * L
  4. Pravi A3 lejaute: 2 poprečna profila po listu (ili 1 ako je profil
     prevelik), uz svaki profil tabelu količina i ispisan proračun.
  5. Na kraju pravi rekapitulaciju (sve profile) + kontrolu sa
     zapreminskom površinom (TIN volume surface), ako postoji.

Pokretanje: Dynamo -> Python Script node (CPython3 ili IronPython2),
nalepiti ceo ovaj fajl. IN[0] = ime osovine (prazno = izbor mišem).
Ili otvoriti priloženi Dokaznica_iskopa.dyn u Dynamo Player-u.
"""
import math
import datetime

# =====================================================================
# PODEŠAVANJA
# =====================================================================
CFG = {
    "PROJEKAT": u"Most Vojislavljevića",
    "NASLOV": u"Dokaznica količina iskopa – leva strana",
    "BROJ_CRTEZA": u"MVO-GT-DO-ZR-01",
    "RAZMERA": 0,                  # 0 = automatski; npr. 200 => 1:200 za sve profile
    "MAX_RAZMERA_2_PO_LISTU": 250, # ako auto razmera za 2 profila/listu prelazi ovo -> 1 profil/listu
    "PREFIKS_LEJAUTA": u"Dok_",
    "OBRISI_STARE_LEJAUTE": True,  # briše lejaute koji počinju prefiksom (ponovno pokretanje)
    "KORISTI_POSTOJECE_PRIKAZE": False, # True: koristi postojeći section view; False: pravi nove na izabranoj tački
    "PRIKAZA_U_REDU": 4,           # broj novih prikaza preseka u jednom redu (model)
    "RAZMAK_PRIKAZA": 30.0,        # razmak između novih prikaza preseka [m]
    "GRUPA_PRESEKA": u"",          # ime sample line grupe; "" = prva sa listom materijala
    "STIL_PRIKAZA_PRESEKA": u"Putevi-SRB",  # podrazumevani izbor u dijalogu
    "SET_TRAKA": u"Milos Band Set",  # podrazumevani set traka u dijalogu
    "BOJA_MATERIJALA": (223, 255, 128),  # početna boja u dijalogu (RGB)
    "BLOK_ZAGLAVLJA": u"",         # ime bloka A3 okvira (0,0 = donji levi ugao papira); "" = crta se jednostavan okvir
    "UREDJAJ": u"DWG To PDF.pc3",
    "FORMAT_PAPIRA": u"ISO_full_bleed_A3_(420.00_x_297.00_MM)",
    "DECIMALNI_ZNAK": u".",
    "ZAOKRUZI_ZA_DOKAZ": True,     # True: računa sa prikazanim (zaokruženim) A i L -> proračun se ručno proverava
                                   # False: računa nezaokruženo kao Civil 3D tabele (razlika par stotih m³)
    "PROREDJIVANJE_TRAKA": 1.0,    # weeding traka [m]: min. razmak oznaka (sprečava preklapanje brojeva); 0 = isključeno
    "MARGINA_PRIKAZA": 2.0,        # dodatna margina oko prikaza preseka u viewportu [m modela]
    "KONTROLNA_POVRSINA": u"",     # ime zapreminske površine za kontrolu; "" = sve zapreminske površine
}

# =====================================================================
# GEOMETRIJA LISTA (mm, A3 položeno 420 x 297)
# =====================================================================
STD_SCALES = [50, 100, 200, 250, 500, 1000, 2000, 5000]
FRAME = (20.0, 10.0, 410.0, 287.0)
TB = (240.0, 10.0, 410.0, 50.0)          # sastavnica
NOTE = (20.0, 10.0, 240.0, 50.0)         # napomena o metodi
SLOT_TOP = (20.0, 168.5, 410.0, 287.0)
SLOT_BOT = (20.0, 50.0, 410.0, 168.5)
SLOT_FULL = (20.0, 50.0, 410.0, 287.0)
PANEL_W = 110.0
VP_MARGIN = 2.0
FIT_FACTOR = 1.04
ROW_H = 6.0
SUM_TOP = 276.0
SUM_BOTTOM = 55.0
SUM_HEADER_H = 10.0
SUM_X = 25.0
SUM_COLS = [22.0, 28.0, 24.0, 26.0, 30.0, 28.0, 32.0]
SEC_COLS = [26.0, 24.0, 26.0, 30.0]

C_TITLE = 2    # žuta
C_HEADER = 30  # narandžasta


# =====================================================================
# ČISTA LOGIKA (bez Civil 3D API - može se testirati van AutoCAD-a)
# =====================================================================
def fmt(v, d=2):
    s = ("{0:." + str(d) + "f}").format(v)
    return s.replace(".", CFG["DECIMALNI_ZNAK"])


def fmt_sta(s):
    km = int(s // 1000.0)
    m = s - km * 1000.0
    return u"{0}+{1}".format(km, fmt(m, 3).zfill(7))


def polygon_area(pts):
    n = len(pts)
    if n < 3:
        return 0.0
    a = 0.0
    for i in range(n):
        x1, y1 = pts[i]
        x2, y2 = pts[(i + 1) % n]
        a += x1 * y2 - x2 * y1
    return abs(a) / 2.0


def compute_quantities(sections, mats):
    """sections: lista dict {name, sta, areas:[A po materijalu]} sortirana po stacionaži.
    Računa sa zaokruženim vrednostima (A 0.01, St 0.001, V 0.01) da bi proračun
    na listu mogao ručno da se proveri do poslednje cifre."""
    rnd = CFG["ZAOKRUZI_ZA_DOKAZ"]
    prev = None
    cum = [0.0] * len(mats)
    for sec in sections:
        sec["sta_r"] = round(sec["sta"], 3) if rnd else sec["sta"]
        sec["A"] = [round(a, 2) for a in sec["areas"]] if rnd else list(sec["areas"])
        sec["L"] = None if prev is None else (
            round(sec["sta_r"] - prev["sta_r"], 3) if rnd else sec["sta_r"] - prev["sta_r"])
        sec["avg"], sec["V"], sec["cum_prev"] = [], [], list(cum)
        for i in range(len(mats)):
            if prev is None:
                avg, v = None, 0.0
            else:
                avg = (prev["A"][i] + sec["A"][i]) / 2.0
                v = round(avg * sec["L"], 2) if rnd else avg * sec["L"]
            cum[i] = round(cum[i] + v, 2) if rnd else cum[i] + v
            sec["avg"].append(avg)
            sec["V"].append(v)
        sec["cum"] = list(cum)
        sec["prev"] = prev
        prev = sec
    return cum


def vp_box(slot):
    x0, y0, x1, y1 = slot
    return (x0 + VP_MARGIN, y0 + VP_MARGIN, x1 - PANEL_W - VP_MARGIN, y1 - VP_MARGIN)


def vp_fit(box, sec):
    """Viewport tačno oko prikaza preseka (da se ne vide susedni prikazi u modelu)."""
    k = 1000.0 / sec["scale"] * FIT_FACTOR
    w = min(box[2] - box[0], sec["w"] * k)
    h = min(box[3] - box[1], sec["h"] * k)
    cx, cy = (box[0] + box[2]) / 2.0, (box[1] + box[3]) / 2.0
    return (cx - w / 2.0, cy - h / 2.0, cx + w / 2.0, cy + h / 2.0)


def panel_box(slot):
    return (slot[2] - PANEL_W, slot[1], slot[2], slot[3])


def fits(sec, slot, s):
    b = vp_box(slot)
    return (sec["w"] * 1000.0 / s * FIT_FACTOR <= b[2] - b[0] and
            sec["h"] * 1000.0 / s * FIT_FACTOR <= b[3] - b[1])


def min_scale(sec, slot):
    for s in STD_SCALES:
        if fits(sec, slot, s):
            return s
    return STD_SCALES[-1]


def plan_sheets(sections):
    """Vraća (razmera, listovi). List = lista (presek, slot)."""
    S = CFG["RAZMERA"]
    if not S:
        S = max(min_scale(sec, SLOT_TOP) for sec in sections)
        if S > CFG["MAX_RAZMERA_2_PO_LISTU"]:
            S = max(min_scale(sec, SLOT_FULL) for sec in sections)
    sheets, cur = [], None
    for sec in sections:
        if fits(sec, SLOT_TOP, S):
            sec["scale"] = S
            if cur is not None and len(cur) == 1 and cur[0][1] == SLOT_TOP:
                cur.append((sec, SLOT_BOT))
            else:
                cur = [(sec, SLOT_TOP)]
                sheets.append(cur)
        else:
            sec["scale"] = S if fits(sec, SLOT_FULL, S) else min_scale(sec, SLOT_FULL)
            cur = [(sec, SLOT_FULL)]
            sheets.append(cur)
    return S, sheets


def plan_summary(sections, mats):
    rows = []
    for i, m in enumerate(mats):
        if len(mats) > 1:
            rows.append(("mat", i))
        for sec in sections:
            rows.append(("row", i, sec))
        rows.append(("total", i))
    if len(mats) > 1:
        rows.append(("grand",))
    per_page = int((SUM_TOP - SUM_HEADER_H - SUM_BOTTOM) / ROW_H)
    return [rows[i:i + per_page] for i in range(0, len(rows), per_page)] or [[]]


# ---------------------------------------------------------------------
# Crtanje (preko "canvas" interfejsa: Civil 3D ili pregled u matplotlib-u)
# ---------------------------------------------------------------------
def draw_table(cv, x, ytop, cols, rows, heights, colors=None):
    """rows: lista redova; red = lista tekstova (len == len(cols)) ili 1 tekst (spojeno)."""
    W = sum(cols)
    y = ytop
    for r, row in enumerate(rows):
        h = heights[r]
        col = colors[r] if colors else None
        cv.line(x, y - h, x + W, y - h, "DOK-TABELA")
        if len(row) == 1:
            cv.text(x + W / 2.0, y - h / 2.0, row[0], 2.5, "MC", layer="DOK-TEKST", color=col)
        else:
            cx = x
            for c, t in enumerate(row):
                if c > 0:
                    cv.line(cx, y, cx, y - h, "DOK-TABELA")
                cv.text(cx + cols[c] / 2.0, y - h / 2.0, t, 2.2, "MC", layer="DOK-TEKST", color=col)
                cx += cols[c]
        y -= h
    cv.rect(x, y, x + W, ytop, "DOK-TABELA")
    return y


def draw_frame(cv, no, total, content, scale_txt, meta):
    if CFG["BLOK_ZAGLAVLJA"] and cv.insert_block(CFG["BLOK_ZAGLAVLJA"]):
        cv.text(FRAME[2] - 2, FRAME[3] - 2, u"List {0}/{1}   R {2}".format(no, total, scale_txt),
                2.5, "TR", layer="DOK-TEKST")
    else:
        cv.rect(FRAME[0], FRAME[1], FRAME[2], FRAME[3], "DOK-OKVIR")
        cv.rect(TB[0], TB[1], TB[2], TB[3], "DOK-OKVIR")
        labels = [u"Projekat", u"Crtež", u"Br. crteža", u"Sadržaj", u"Osovina", u"Razmera"]
        values = [CFG["PROJEKAT"], CFG["NASLOV"], CFG["BROJ_CRTEZA"], content,
                  u"{0}   (grupa: {1})".format(meta["alignment"], meta["slg"]),
                  u"{0}          List {1} / {2}          Datum {3}".format(
                      scale_txt, no, total, meta["date"])]
        rh = (TB[3] - TB[1]) / len(labels)
        for i, (l, v) in enumerate(zip(labels, values)):
            y = TB[3] - (i + 1) * rh
            if i:
                cv.line(TB[0], y + rh, TB[2], y + rh, "DOK-OKVIR")
            cv.text(TB[0] + 1.5, y + rh / 2.0, l, 2.2, "ML", layer="DOK-TEKST", color=C_HEADER)
            cv.text(TB[0] + 26.5, y + rh / 2.0, v, 2.5 if i == 0 else 2.2, "ML", layer="DOK-TEKST")
        cv.line(TB[0] + 25, TB[1], TB[0] + 25, TB[3], "DOK-OKVIR")
    cv.rect(NOTE[0], NOTE[1], NOTE[2], NOTE[3], "DOK-OKVIR")
    cv.text(NOTE[0] + 2, NOTE[3] - 2, method_note(meta), 2.2, "TL",
            width=NOTE[2] - NOTE[0] - 4, layer="DOK-TEKST")


def method_note(meta):
    return (u"NAPOMENA – metoda proračuna: srednje površine poprečnih profila\n"
            u"V(i) = (A(i-1) + A(i)) / 2 × L(i),     L(i) = St(i) − St(i-1)\n"
            u"A – površina materijala u poprečnom profilu (Civil 3D lista materijala: {0})\n"
            u"Zaokruživanje: A na 0.01 m², St i L na 0.001 m, V na 0.01 m³ "
            u"(proračun se može proveriti ručno sa prikazanim vrednostima).").format(meta["mlist"])


def draw_section_panel(cv, sec, slot, mats):
    px0, py0, px1, py1 = panel_box(slot)
    x = px0 + 2
    cv.rect(slot[0], slot[1], slot[2], slot[3], "DOK-OKVIR")
    cv.line(px0, py0, px0, py1, "DOK-OKVIR")
    cv.text(x, py1 - 3, u"POPREČNI PROFIL {0}\nSt. {1}     R 1:{2}".format(
        sec["name"], fmt_sta(sec["sta"]), sec["scale"]), 3.0, "TL", layer="DOK-TEKST", color=C_TITLE)
    rows = [[u"Količine"], [u"Materijal", u"Površina\n[m²]", u"Zapremina\n[m³]", u"Ukupna zapr.\n[m³]"]]
    heights = [6.0, 9.0]
    colors = [C_TITLE, C_HEADER]
    for i, m in enumerate(mats):
        rows.append([m, fmt(sec["A"][i]), fmt(sec["V"][i]), fmt(sec["cum"][i])])
        heights.append(ROW_H)
        colors.append(None)
    y = draw_table(cv, x, py1 - 16, SEC_COLS, rows, heights, colors)

    p = sec["prev"]
    if p is None:
        lines = [u"Proračun zapremine:", u"Početni profil – nema prethodnog profila.",
                 u"V = 0.00 m³"]
    else:
        lines = [u"Proračun zapremine (metoda srednjih površina):",
                 u"L = {0} − {1} = {2} m".format(fmt(sec["sta_r"], 3), fmt(p["sta_r"], 3), fmt(sec["L"], 3)),
                 u"V = (A({0}) + A({1})) / 2 × L".format(p["name"], sec["name"])]
        for i, m in enumerate(mats):
            if len(mats) > 1:
                lines.append(u"{0}:".format(m))
            lines.append(u"V = ({0} + {1}) / 2 × {2}".format(fmt(p["A"][i]), fmt(sec["A"][i]), fmt(sec["L"], 3)))
            lines.append(u"   = {0} × {1} = {2} m³".format(fmt(sec["avg"][i], 3), fmt(sec["L"], 3), fmt(sec["V"][i])))
            lines.append(u"ΣV = {0} + {1} = {2} m³".format(fmt(sec["cum_prev"][i]), fmt(sec["V"][i]), fmt(sec["cum"][i])))
    cv.text(x, y - 4, u"\n".join(lines), 2.2, "TL", width=PANEL_W - 4, layer="DOK-TEKST")


def draw_summary_page(cv, page, sections, mats, totals, first, meta):
    head = [u"Profil", u"Stacionaža\n[km+m]", u"Rastojanje\nL [m]", u"Površina\nA [m²]",
            u"Sr. površina\n(A1+A2)/2 [m²]", u"Zapremina\nV [m³]", u"Ukupno\nΣV [m³]"]
    rows, heights, colors = [head], [SUM_HEADER_H], [C_HEADER]
    for r in page:
        if r[0] == "mat":
            rows.append([u"Materijal: {0}".format(mats[r[1]])]); colors.append(C_TITLE)
        elif r[0] == "row":
            i, sec = r[1], r[2]
            first_sec = sec["prev"] is None
            rows.append([sec["name"], fmt_sta(sec["sta"]),
                         u"–" if first_sec else fmt(sec["L"], 3), fmt(sec["A"][i]),
                         u"–" if first_sec else fmt(sec["avg"][i], 3),
                         u"–" if first_sec else fmt(sec["V"][i]), fmt(sec["cum"][i])])
            colors.append(None)
        elif r[0] == "total":
            i = r[1]
            rows.append([u"UKUPNO {0}".format(mats[i]) if len(mats) > 1 else u"UKUPNO",
                         u"", fmt(sections[-1]["sta_r"] - sections[0]["sta_r"], 3), u"", u"",
                         fmt(totals[i]), fmt(totals[i])])
            colors.append(C_TITLE)
        else:
            rows.append([u"SVEGA SVI MATERIJALI: {0} m³".format(fmt(sum(totals)))]); colors.append(C_TITLE)
        heights.append(ROW_H)
    cv.text(SUM_X, SUM_TOP + 3.5, u"REKAPITULACIJA KOLIČINA ISKOPA", 3.5, "BL",
            layer="DOK-TEKST", color=C_TITLE)
    draw_table(cv, SUM_X, SUM_TOP, SUM_COLS, rows, heights, colors)

    if first:
        x = SUM_X + sum(SUM_COLS) + 8
        lines = [u"Osovina: {0}".format(meta["alignment"]),
                 u"Grupa poprečnih preseka: {0}".format(meta["slg"]),
                 u"Lista materijala: {0}".format(meta["mlist"]),
                 u"Broj profila: {0}   (St. {1} – {2})".format(
                     len(sections), fmt_sta(sections[0]["sta"]), fmt_sta(sections[-1]["sta"])),
                 u"",
                 u"Metoda: srednje površine poprečnih profila",
                 u"V(i) = (A(i-1) + A(i)) / 2 × L(i)",
                 u"L(i) = St(i) − St(i-1)",
                 u"ΣV = Σ V(i)",
                 u""]
        for i, m in enumerate(mats):
            lines.append(u"Ukupna zapremina – {0}: {1} m³".format(m, fmt(totals[i])))
        if meta["control"]:
            lines += [u"", u"KONTROLA (zapreminska površina TIN – TIN):"]
            tot = sum(totals)
            for name, cut, fill in meta["control"]:
                d = tot - cut
                pct = (d / cut * 100.0) if cut else 0.0
                lines.append(u"„{0}“: iskop = {1} m³, nasip = {2} m³".format(name, fmt(cut), fmt(fill)))
                lines.append(u"   razlika profili − površina = {0} m³ ({1} %)".format(fmt(d), fmt(pct, 2)))
        cv.text(x, SUM_TOP, u"\n".join(lines), 2.5, "TL", width=FRAME[2] - x - 4, layer="DOK-TEKST")


def draw_all(cv, sections, mats, meta):
    totals = compute_quantities(sections, mats)
    S, sheets = plan_sheets(sections)
    pages = plan_summary(sections, mats)
    total = len(sheets) + len(pages)
    pre = CFG["PREFIKS_LEJAUTA"]
    names = []
    for n, sheet in enumerate(sheets):
        secs = [it[0] for it in sheet]
        name = u"{0}{1:02d} {2}".format(pre, n + 1, u"-".join(s["name"] for s in secs))
        names.append(name)
        cv.begin_sheet(name)
        scales = sorted(set(s["scale"] for s in secs))
        draw_frame(cv, n + 1, total, u"Poprečni profili " + u", ".join(s["name"] for s in secs),
                   u", ".join(u"1:{0}".format(s) for s in scales), meta)
        for sec, slot in sheet:
            cv.viewport(vp_fit(vp_box(slot), sec), sec)
            draw_section_panel(cv, sec, slot, mats)
    for k, page in enumerate(pages):
        name = u"{0}Rekap_{1:02d}".format(pre, k + 1)
        names.append(name)
        cv.begin_sheet(name)
        draw_frame(cv, len(sheets) + k + 1, total, u"Rekapitulacija količina iskopa", u"–", meta)
        draw_summary_page(cv, page, sections, mats, totals, k == 0, meta)
    return S, names, totals


# =====================================================================
# CIVIL 3D DEO
# =====================================================================
# =====================================================================
# DIJALOZI (WinForms) - rade u Dynamo-u (CPython3 / IronPython2)
# =====================================================================
NEW_LIST = u"<Nova lista materijala>"
NO_BANDS = u"(bez traka)"
NONE_SRC = u"(nijedan)"


def _wf():
    import clr
    clr.AddReference("System.Windows.Forms")
    clr.AddReference("System.Drawing")
    import System.Windows.Forms as F
    import System.Drawing as D
    return F, D


def _guess(names, keys, default_idx=0):
    """Najbolje poklapanje imena: tačno > počinje sa > sadrži."""
    low = [n.lower().strip() for n in names]
    for test in (lambda n, k: n == k, lambda n, k: n.startswith(k), lambda n, k: k in n):
        for k in keys:
            for i, n in enumerate(low):
                if test(n, k):
                    return i
    return default_idx if names else -1


def _combo(F, D, form, x, y, w, items, sel):
    c = F.ComboBox()
    c.DropDownStyle = F.ComboBoxStyle.DropDownList
    c.Location = D.Point(x, y)
    c.Width = w
    for it in items:
        c.Items.Add(it)
    if items:
        c.SelectedIndex = max(0, min(sel, len(items) - 1))
    form.Controls.Add(c)
    return c


def _label(F, D, form, x, y, text, w=170, bold=False):
    l = F.Label()
    l.Text = text
    l.Location = D.Point(x, y + 3)
    l.Size = D.Size(w, 20)
    if bold:
        l.Font = D.Font(form.Font, D.FontStyle.Bold)
    form.Controls.Add(l)
    return l


def _buttons(F, D, form, y):
    ok = F.Button()
    ok.Text = u"U redu"
    ok.DialogResult = F.DialogResult.OK
    ok.Location = D.Point(form.ClientSize.Width - 200, y)
    ok.Width = 90
    ca = F.Button()
    ca.Text = u"Otkaži"
    ca.DialogResult = F.DialogResult.Cancel
    ca.Location = D.Point(form.ClientSize.Width - 100, y)
    ca.Width = 90
    form.Controls.Add(ok)
    form.Controls.Add(ca)
    form.AcceptButton = ok
    form.CancelButton = ca


def _new_form(F, D, title, w, h):
    f = F.Form()
    f.Text = title
    f.Font = D.Font("Segoe UI", 9.0)
    f.FormBorderStyle = F.FormBorderStyle.FixedDialog
    f.MaximizeBox = False
    f.MinimizeBox = False
    f.StartPosition = F.FormStartPosition.CenterScreen
    f.ClientSize = D.Size(w, h)
    return f


def settings_dialog(d, show=None):
    """d: sv_styles, sv_default, band_sets, band_default, mlists, surfaces,
    color (r,g,b), pick_color() -> (r,g,b) ili None.
    show(form) -> True ako je potvrđeno. Vraća dict ili None."""
    F, D = _wf()
    f = _new_form(F, D, u"Dokaznica iskopa – podešavanja", 560, 420)
    X1, X2, W = 15, 200, 340
    y = 15
    _label(F, D, f, X1, y, u"Prikaz poprečnih preseka", 400, True); y += 28
    _label(F, D, f, X1, y, u"Stil prikaza preseka:")
    c_style = _combo(F, D, f, X2, y, W, d["sv_styles"], d["sv_default"]); y += 32
    _label(F, D, f, X1, y, u"Set traka (kote, rastojanja):")
    c_band = _combo(F, D, f, X2, y, W, [NO_BANDS] + d["band_sets"], d["band_default"] + 1); y += 42

    _label(F, D, f, X1, y, u"Materijal (Compute Materials)", 400, True); y += 28
    _label(F, D, f, X1, y, u"Lista materijala:")
    c_list = _combo(F, D, f, X2, y, W, d["mlists"] + [NEW_LIST], 0); y += 32
    _label(F, D, f, X1, y, u"Naziv nove liste / materijala:")
    t_list = F.TextBox(); t_list.Location = D.Point(X2, y); t_list.Width = 165; t_list.Text = u"Dokaznica"
    t_mat = F.TextBox(); t_mat.Location = D.Point(X2 + 175, y); t_mat.Width = 165; t_mat.Text = u"Iskop"
    f.Controls.Add(t_list); f.Controls.Add(t_mat); y += 32
    _label(F, D, f, X1, y, u"Postojeći teren (ispod njega):")
    c_eg = _combo(F, D, f, X2, y, W, d["surfaces"],
                  _guess(d["surfaces"], [u"nulto", u"teren", u"postoj", u"existing", u"eg"])); y += 32
    _label(F, D, f, X1, y, u"Površina iskopa (iznad nje):")
    c_dg = _combo(F, D, f, X2, y, W, d["surfaces"],
                  _guess(d["surfaces"], [u"iskop", u"projekt", u"dno", u"design"], 1)); y += 32

    def on_list(sender, args):
        new = c_list.SelectedItem == NEW_LIST
        for c in (t_list, t_mat, c_eg, c_dg):
            c.Enabled = new
    c_list.SelectedIndexChanged += on_list
    on_list(None, None)

    _label(F, D, f, X1, y + 8, u"Boja materijala (šrafura):", 400, True); y += 36
    chk = F.CheckBox(); chk.Text = u"Promeni boju"; chk.Location = D.Point(X1, y); chk.Width = 170
    chk.Checked = False
    f.Controls.Add(chk)
    sw = F.Panel(); sw.Location = D.Point(X2, y); sw.Size = D.Size(60, 24)
    sw.BorderStyle = F.BorderStyle.FixedSingle
    state = {"rgb": tuple(d["color"])}
    sw.BackColor = D.Color.FromArgb(*state["rgb"])
    f.Controls.Add(sw)
    b = F.Button(); b.Text = u"Izaberi boju..."; b.Location = D.Point(X2 + 70, y); b.Width = 120
    f.Controls.Add(b)

    def on_color(sender, args):
        rgb = d["pick_color"](state["rgb"])
        if rgb:
            state["rgb"] = tuple(rgb)
            sw.BackColor = D.Color.FromArgb(*state["rgb"])
            chk.Checked = True
    b.Click += on_color
    y += 50
    _buttons(F, D, f, y)

    if show is None or not show(f):
        return f if show is None else None
    new = c_list.SelectedItem == NEW_LIST
    return {
        "sv_style": c_style.SelectedItem,
        "band_set": None if c_band.SelectedIndex <= 0 else c_band.SelectedItem,
        "mlist": None if new else c_list.SelectedItem,
        "new_list": t_list.Text.strip() or u"Dokaznica",
        "new_mat": t_mat.Text.strip() or u"Iskop",
        "eg": c_eg.SelectedItem, "dg": c_dg.SelectedItem,
        "recolor": bool(chk.Checked), "rgb": state["rgb"],
    }


def bands_dialog(bands, sources, s1_default, s2_default, show=None):
    """Izbor izvora (Section 1 / Section 2) za svaku traku. Vraća listu (s1, s2) imena."""
    F, D = _wf()
    items = [NONE_SRC] + list(sources)
    h = 90 + 32 * len(bands) + 50
    f = _new_form(F, D, u"Dokaznica iskopa – izvori podataka za trake", 720, h)
    _label(F, D, f, 15, 12, u"Za svaku traku izaberite izvor preseka (kao u Civil 3D čarobnjaku):", 690)
    _label(F, D, f, 15, 40, u"Traka", 250, True)
    _label(F, D, f, 280, 40, u"Section 1", 200, True)
    _label(F, D, f, 495, 40, u"Section 2", 200, True)
    y = 70
    rows = []
    for name in bands:
        _label(F, D, f, 15, y, name, 255)
        lo = name.lower()
        s1 = s2_default if (u"projekt" in lo or u"design" in lo) else s1_default
        c1 = _combo(F, D, f, 280, y, 205, items, items.index(s1) if s1 in items else 0)
        c2 = _combo(F, D, f, 495, y, 205, items, items.index(s2_default) if s2_default in items else 0)
        rows.append((c1, c2))
        y += 32
    _buttons(F, D, f, y + 15)
    if show is None or not show(f):
        return f if show is None else None
    out = []
    for c1, c2 in rows:
        out.append((None if c1.SelectedItem == NONE_SRC else c1.SelectedItem,
                    None if c2.SelectedItem == NONE_SRC else c2.SelectedItem))
    return out


def _civ(name):
    """Pronalazi Civil 3D tip/enum po imenu u poznatim imenskim prostorima."""
    import importlib
    for modname in ("Autodesk.Civil", "Autodesk.Civil.DatabaseServices",
                    "Autodesk.Civil.DatabaseServices.Styles"):
        try:
            mod = importlib.import_module(modname)
            if hasattr(mod, name):
                return getattr(mod, name)
        except Exception:
            pass
    return None


def _prop_info(obj, name, need_read):
    """Traži svojstvo kroz hijerarhiju klasa (za pythonnet: izvedena klasa može imati samo setter/getter)."""
    from System.Reflection import BindingFlags
    flags = BindingFlags.Public | BindingFlags.Instance | BindingFlags.DeclaredOnly
    t = obj.GetType()
    while t is not None:
        p = t.GetProperty(name, flags)
        if p is not None and (p.CanRead if need_read else p.CanWrite):
            return p
        t = t.BaseType
    return None


def get_prop(obj, name):
    """Čita svojstvo; ako pythonnet javi 'property cannot be read', čita preko refleksije."""
    try:
        return getattr(obj, name)
    except Exception:
        p = _prop_info(obj, name, True)
        if p is None:
            raise
        return p.GetValue(obj, None)


def set_prop(obj, name, value):
    try:
        setattr(obj, name, value)
    except Exception:
        p = _prop_info(obj, name, False)
        if p is None:
            raise
        p.SetValue(obj, value, None)


def obj_name(obj):
    try:
        return get_prop(obj, "Name")
    except Exception:
        return u"?"


def _style_map(tr, coll, log=None):
    out = []
    if coll is None:
        return out
    for sid in coll:
        try:
            out.append((obj_name(tr.GetObject(sid, OpenModeRef[0].ForRead)), sid))
        except Exception as e:
            if log is not None:
                log.append(u"Upozorenje: stil nije pročitan: {0}".format(e))
    return out


OpenModeRef = [None]


def recolor_style(tr, style_id, color, log):
    """Postavlja boju na sve komponente prikaza stila. Metode GetDisplayStyle*(enum) se
    pronalaze refleksijom, pa ne zavise od imena enum tipova u Civil 3D API-ju."""
    from System import Enum, Array, Object
    st = tr.GetObject(style_id, OpenModeRef[0].ForWrite)
    n, errs = 0, []
    for mi in st.GetType().GetMethods():
        if not mi.Name.startswith("GetDisplayStyle"):
            continue
        ps = mi.GetParameters()
        if len(ps) != 1 or not ps[0].ParameterType.IsEnum:
            continue
        for v in Enum.GetValues(ps[0].ParameterType):
            try:
                ds = mi.Invoke(st, Array[Object]([v]))
                set_prop(ds, "Color", color)
                n += 1
            except Exception as e:
                errs.append(u"{0}({1}): {2}".format(mi.Name, v, e))
    if n == 0:
        log.append(u"Upozorenje: boja stila '{0}' nije promenjena – promenite ručno. {1}".format(
            obj_name(st), u"; ".join(errs[:3])))
    else:
        log.append(u"Stil '{0}': boja postavljena na {1} komponenti prikaza.".format(obj_name(st), n))
    return n


def run_civil(IN):
    import clr
    for ref in ("AcMgd", "AcCoreMgd", "AcDbMgd", "AecBaseMgd", "AecPropDataMgd", "AeccDbMgd"):
        clr.AddReference(ref)
    from Autodesk.AutoCAD.ApplicationServices import Application
    from Autodesk.AutoCAD.DatabaseServices import (
        OpenMode, Line, Polyline, MText, Viewport, AttachmentPoint, LayoutManager,
        PlotSettings, PlotSettingsValidator, PlotPaperUnit, PlotRotation, PlotType,
        StdScaleType, LayerTableRecord, TextStyleTableRecord, BlockReference, ObjectId)
    from Autodesk.AutoCAD.Geometry import Point2d, Point3d, Vector3d, Matrix3d
    from Autodesk.AutoCAD.EditorInput import PromptEntityOptions, PromptPointOptions, PromptStatus
    from Autodesk.AutoCAD.Colors import Color, ColorMethod
    from Autodesk.AutoCAD.GraphicsInterface import FontDescriptor
    from Autodesk.Civil.ApplicationServices import CivilApplication
    from Autodesk.Civil.DatabaseServices import Alignment, SectionView, TinVolumeSurface
    OpenModeRef[0] = OpenMode

    doc = Application.DocumentManager.MdiActiveDocument
    db, ed = doc.Database, doc.Editor
    civdoc = CivilApplication.ActiveDocument
    log = []
    R, W = OpenMode.ForRead, OpenMode.ForWrite

    import io, os, tempfile
    trace_path = os.path.join(tempfile.gettempdir(), u"dokaznica_trace.txt")
    io.open(trace_path, "w", encoding="utf-8").close()

    def trace(msg):
        with io.open(trace_path, "a", encoding="utf-8") as f_:
            f_.write(u"{0}\n".format(msg))

    def show_modal(form):
        from System.Windows.Forms import DialogResult
        return Application.ShowModalDialog(form) == DialogResult.OK

    # ---------- 1. izbor osovine ----------
    aln_name = u"{0}".format(IN[0]).strip() if IN and IN[0] else u""
    aln_id = None
    if aln_name:
        tr = db.TransactionManager.StartTransaction()
        try:
            ids = list(civdoc.GetAlignmentIds())
            for sid in civdoc.GetSiteIds():
                ids += list(tr.GetObject(sid, R).GetAlignmentIds())
            for i in ids:
                if tr.GetObject(i, R).Name == aln_name:
                    aln_id = i
        finally:
            tr.Dispose()
        if aln_id is None:
            return [u"GREŠKA: osovina '{0}' nije pronađena.".format(aln_name)]
    else:
        peo = PromptEntityOptions(u"\nIzaberite osovinu (alignment) za dokaznicu: ")
        peo.SetRejectMessage(u"\nIzabrani objekat nije osovina.")
        peo.AddAllowedClass(clr.GetClrType(Alignment), True)
        res = ed.GetEntity(peo)
        if res.Status != PromptStatus.OK:
            return [u"Prekinuto – osovina nije izabrana. (Ime osovine možete upisati na ulaz IN[0].)"]
        aln_id = res.ObjectId

    trace(u"1 osovina izabrana")
    # ---------- 2. čitanje podataka za dijalog ----------
    tr = db.TransactionManager.StartTransaction()
    try:
        aln = tr.GetObject(aln_id, R)
        aln_name = aln.Name
        slg = None
        for gid in aln.GetSampleLineGroupIds():
            g = tr.GetObject(gid, R)
            if CFG["GRUPA_PRESEKA"]:
                if g.Name == CFG["GRUPA_PRESEKA"]:
                    slg = g
            elif slg is None or (slg.MaterialLists.Count == 0 and g.MaterialLists.Count > 0):
                slg = g
        if slg is None:
            return [u"GREŠKA: osovina '{0}' nema grupu poprečnih preseka (sample lines).".format(aln_name)]
        slg_id, slg_name = slg.ObjectId, slg.Name
        mlist_names = [slg.MaterialLists[i].Name for i in range(slg.MaterialLists.Count)]

        sv_styles = _style_map(tr, civdoc.Styles.SectionViewStyles, log)
        band_sets = _style_map(tr, getattr(civdoc.Styles, "SectionViewBandSetStyles", None), log)
        trace(u"2 stilova: {0}, setova traka: {1}".format(len(sv_styles), len(band_sets)))
        surfaces = []
        for sid in civdoc.GetSurfaceIds():
            s = tr.GetObject(sid, R)
            if not isinstance(s, TinVolumeSurface):
                surfaces.append((s.Name, sid))
        trace(u"2 preseci po uzorkovanim linijama")
        sec_ids = {}   # slid -> {ime izvora: id preseka}; ime preseka je "<profil>-<izvor>"
        source_names = []

        lines = []   # (slid, ime, stacionaža, postojeći prikaz ili None)
        for slid in slg.GetSampleLineIds():
            sl = tr.GetObject(slid, R)
            d_ = {}
            try:
                surf_names = sorted([n_ for n_, i_ in surfaces], key=len, reverse=True)
                for sid in sl.GetSectionIds():
                    full = obj_name(tr.GetObject(sid, R))
                    # ime preseka -> ime površine (najduže poklapanje), inače bez prefiksa profila
                    nm = next((sn for sn in surf_names if full == sn or full.endswith(sn)), None)
                    if nm is None:
                        nm = full[len(sl.Name) + 1:] if full.startswith(sl.Name + u"-") else full
                    d_[nm] = sid
                    if not sec_ids:
                        trace(u"2 presek '{0}' -> izvor '{1}'".format(full, nm))
                    if nm not in source_names:
                        source_names.append(nm)
            except Exception as e:
                log.append(u"Upozorenje: preseci za {0}: {1}".format(sl.Name, e))
            sec_ids[slid] = d_
            vids = sl.GetSectionViewIds()
            keep = None
            if CFG["KORISTI_POSTOJECE_PRIKAZE"]:
                for k in range(vids.Count):
                    if not tr.GetObject(vids[k], R).Name.startswith(u"DOK-"):
                        keep = vids[k]
                        break
            lines.append((slid, sl.Name, sl.Station, keep))
        if not lines:
            return [u"GREŠKA: grupa preseka nema uzorkovanih linija."]
        lines.sort(key=lambda t: t[2])
    finally:
        tr.Dispose()

    trace(u"3 dijalog podešavanja")
    # ---------- 3. dijalog podešavanja ----------
    names = [n for n, i in sv_styles]
    bnames = [n for n, i in band_sets]
    picked = {"acad": None}

    def pick_color(rgb):
        from Autodesk.AutoCAD.Windows import ColorDialog
        from System.Windows.Forms import DialogResult
        cd = ColorDialog()
        cd.Color = Color.FromRgb(rgb[0], rgb[1], rgb[2])
        if cd.ShowDialog() == DialogResult.OK:
            picked["acad"] = cd.Color
            cv_ = cd.Color.ColorValue
            return (cv_.R, cv_.G, cv_.B)
        return None

    ui = settings_dialog({
        "sv_styles": names,
        "sv_default": names.index(CFG["STIL_PRIKAZA_PRESEKA"]) if CFG["STIL_PRIKAZA_PRESEKA"] in names
        else max(0, _guess(names, [u"putevi-srb", u"srb"])),
        "band_sets": bnames,
        "band_default": bnames.index(CFG["SET_TRAKA"]) if CFG["SET_TRAKA"] in bnames
        else _guess(bnames, [u"putevi-srb", u"srb", u"putevi"], -1),
        "mlists": mlist_names,
        "surfaces": [n for n, i in surfaces],
        "color": CFG["BOJA_MATERIJALA"], "pick_color": pick_color}, show=show_modal)
    if ui is None:
        return [u"Prekinuto u dijalogu."]
    sv_style_id = dict(sv_styles).get(ui["sv_style"])
    band_set_id = dict(band_sets).get(ui["band_set"]) if ui["band_set"] else None

    trace(u"4 tačka umetanja (dijalog: {0})".format(ui))
    # ---------- 4. tačka umetanja ----------
    base = None
    if any(t[3] is None for t in lines):
        ppo = PromptPointOptions(u"\nIzaberite tačku umetanja za prikaze poprečnih preseka "
                                 u"(ređaju se udesno, {0} u redu): ".format(CFG["PRIKAZA_U_REDU"]))
        res = ed.GetPoint(ppo)
        if res.Status != PromptStatus.OK:
            return [u"Prekinuto – tačka umetanja nije izabrana."]
        base = res.Value

    trace(u"4 zaključavanje dokumenta")
    lock = doc.LockDocument()
    old_lcv = None
    try:
        # ---------- 5a. lista materijala (nova ili postojeća) ----------
        trace(u"5a lista materijala: {0}".format(ui["mlist"] or u"NOVA"))
        tr = db.TransactionManager.StartTransaction()
        try:
            slg_w = tr.GetObject(slg_id, W)
            mls = slg_w.MaterialLists
            ml = None
            if ui["mlist"] is None:
                surf = dict(surfaces)
                eg_id, dg_id = surf.get(ui["eg"]), surf.get(ui["dg"])
                if eg_id is None or dg_id is None or eg_id == dg_id:
                    return [u"GREŠKA: za novu listu materijala izaberite dve različite površine."]
                lname = ui["new_list"]
                k = 2
                while lname in mlist_names:
                    lname = u"{0} ({1})".format(ui["new_list"], k); k += 1
                try:
                    trace(u"5a mls.Add"); ml = mls.Add(lname)
                    trace(u"5a ml.Add"); mat = ml.Add(ui["new_mat"])
                    qt = _civ("MaterialQuantityType")
                    if qt is not None:
                        trace(u"5a QuantityType"); mat.QuantityType = qt.Cut
                    cond = _civ("MaterialConditionType")
                    trace(u"5a item teren"); it1 = mat.Add(eg_id)
                    it1.Condition = cond.Below      # ispod postojećeg terena
                    trace(u"5a item iskop"); it2 = mat.Add(dg_id)
                    it2.Condition = cond.Above      # iznad površine iskopa
                except Exception as e:
                    return [u"GREŠKA pri pravljenju liste materijala: {0}".format(e),
                            u"Napravite je ručno: Analyze > Compute Materials "
                            u"(teren = Below, iskop = Above), pa pokrenite ponovo."] + log
                log.append(u"Napravljena lista materijala '{0}' / '{1}' (ispod '{2}', iznad '{3}').".format(
                    lname, ui["new_mat"], ui["eg"], ui["dg"]))
            else:
                for i in range(mls.Count):
                    if mls[i].Name == ui["mlist"]:
                        ml = mls[i]
            mat_keys = [(ml.Guid, ml[j].Guid, ml[j].Name, ml.Name) for j in range(ml.Count)]
            mats = [k_[2] for k_ in mat_keys]
            mlist_used = ml.Name
            cur_styles = []
            for j in range(ml.Count):
                try:
                    cur_styles.append(get_prop(ml[j], "ShapeStyleId"))
                except Exception:
                    cur_styles.append(ObjectId.Null)
            tr.Commit()
        finally:
            tr.Dispose()
        trace(u"5a gotovo")

        # ---------- 5b. boja materijala: kopija stila "DOK-<materijal>" ----------
        if ui["recolor"]:
            rgb = ui["rgb"]
            col = picked["acad"] or Color.FromRgb(rgb[0], rgb[1], rgb[2])
            new_styles = []
            tr = db.TransactionManager.StartTransaction()
            try:
                shape_styles = civdoc.Styles.ShapeStyles
                existing = dict((obj_name(tr.GetObject(sid, R)), sid) for sid in shape_styles)
                for j, mname in enumerate(mats):
                    new_name = u"DOK-{0}".format(mname)
                    sty = existing.get(new_name)
                    try:
                        if sty is None:
                            cur = cur_styles[j]
                            if cur.IsNull:
                                cur = list(shape_styles)[0]
                            trace(u"5b CopyAsSibling {0}".format(new_name))
                            sty = tr.GetObject(cur, W).CopyAsSibling(new_name)
                        trace(u"5b recolor {0}".format(new_name))
                        recolor_style(tr, sty, col, log)
                    except Exception as e:
                        sty = None
                        log.append(u"Upozorenje: stil '{0}' nije napravljen: {1}".format(new_name, e))
                    new_styles.append(sty)
                tr.Commit()
            finally:
                tr.Dispose()
            tr = db.TransactionManager.StartTransaction()
            try:
                slg_w = tr.GetObject(slg_id, W)
                mls = slg_w.MaterialLists
                for i in range(mls.Count):
                    if mls[i].Name == mlist_used:
                        ml = mls[i]
                for j in range(ml.Count):
                    if new_styles[j] is None:
                        continue
                    try:
                        trace(u"5b ShapeStyleId {0}".format(mats[j]))
                        set_prop(ml[j], "ShapeStyleId", new_styles[j])
                        log.append(u"Materijal '{0}': stil 'DOK-{0}', boja {1}.".format(mats[j], rgb))
                    except Exception as e:
                        log.append(u"Upozorenje: stil materijala '{0}' nije dodeljen: {1}. Ručno: Sample Line "
                                   u"Group Properties > Material List > Style = 'DOK-{0}'.".format(mats[j], e))
                tr.Commit()
            finally:
                tr.Dispose()
        trace(u"5b gotovo")
        ed.Regen()

        # ---------- 6. prikazi preseka ----------
        if base is not None:
            trace(u"6 brisanje starih DOK- prikaza")
            tr = db.TransactionManager.StartTransaction()
            try:
                for slid, name, sta, keep in lines:
                    if keep is None:
                        vids = tr.GetObject(slid, R).GetSectionViewIds()
                        for k in range(vids.Count):
                            v = tr.GetObject(vids[k], R)
                            if v.Name.startswith(u"DOK-"):
                                v.UpgradeOpen()
                                v.Erase()
                tr.Commit()
            finally:
                tr.Dispose()

        band_map = None   # lista (Section1 ime, Section2 ime) po traci
        gap = CFG["RAZMAK_PRIKAZA"]
        x, y = (base.X, base.Y) if base is not None else (0.0, 0.0)
        row_bottom, row_limit, prev_right, n_in_row = None, None, None, 0
        sections, sec_box0 = [], {}
        for slid, name, sta, keep in lines:
            box0 = None
            if keep is not None:
                svid = keep
            else:
                trace(u"6 prikaz {0}".format(name))
                tr = db.TransactionManager.StartTransaction()
                try:
                    svid = SectionView.Create(u"DOK-{0}-{1}".format(aln_name, name), slid, Point3d(x, y, 0))
                    tr.Commit()
                finally:
                    tr.Dispose()
                # granice odmah posle pravljenja (pre promene stila/traka) - za dijagnostiku i rezervu
                tr = db.TransactionManager.StartTransaction()
                try:
                    box0, src0, errs0 = view_extents(tr.GetObject(svid, R))
                finally:
                    tr.Dispose()
                trace(u"6 granice posle Create: {0}".format(box0))
                tr = db.TransactionManager.StartTransaction()
                try:
                    sv = tr.GetObject(svid, W)
                    if sv_style_id is not None:
                        sv.StyleId = sv_style_id
                    if band_set_id is not None:
                        try:
                            trace(u"6 ImportBandSetStyle")
                            sv.Bands.ImportBandSetStyle(band_set_id)
                        except Exception as e:
                            log.append(u"Upozorenje: set traka za {0}: {1}".format(name, e))
                    tr.Commit()
                finally:
                    tr.Dispose()
                if band_set_id is not None:
                    if band_map is None:
                        tr = db.TransactionManager.StartTransaction()
                        try:
                            items = tr.GetObject(svid, R).Bands.GetBottomBandItems()
                            bn = [obj_name(tr.GetObject(get_prop(items[i], "BandStyleId"), R)) for i in range(items.Count)]
                        finally:
                            tr.Dispose()
                        band_map = []
                        if bn:
                            band_map = bands_dialog(
                                bn, source_names,
                                ui["eg"] if ui["eg"] in source_names else (source_names[0] if source_names else None),
                                ui["dg"] if ui["dg"] in source_names else None,
                                show=show_modal) or []
                    if band_map:
                        trace(u"6 izvori traka {0}".format(name))
                        tr = db.TransactionManager.StartTransaction()
                        try:
                            sv = tr.GetObject(svid, W)
                            ids_ = sec_ids.get(slid, {})
                            items = sv.Bands.GetBottomBandItems()
                            for i in range(min(items.Count, len(band_map))):
                                s1, s2 = band_map[i]
                                if s1 in ids_:
                                    set_prop(items[i], "Section1Id", ids_[s1])
                                if s2 in ids_:
                                    set_prop(items[i], "Section2Id", ids_[s2])
                                if CFG["PROREDJIVANJE_TRAKA"] > 0:
                                    try:
                                        set_prop(items[i], "Weeding", float(CFG["PROREDJIVANJE_TRAKA"]))
                                    except Exception as e:
                                        if not sections:
                                            log.append(u"Upozorenje: proređivanje trake: {0}".format(e))
                                if not sections:
                                    trace(u"6 traka {0}: S1={1} ({2}), S2={3} ({4})".format(
                                        i, s1, s1 in ids_, s2, s2 in ids_))
                            sv.Bands.SetBottomBandItems(items)
                            tr.Commit()
                        except Exception as e:
                            log.append(u"Upozorenje: izvori traka za {0}: {1}".format(name, e))
                        finally:
                            tr.Dispose()
            tr = db.TransactionManager.StartTransaction()
            try:
                sv = tr.GetObject(svid, R)
                box, src, errs = view_extents(sv)
                if box is None:
                    ed.Regen()
                    box, src, errs2 = view_extents(sv)
                    errs += errs2
                svname = sv.Name
            finally:
                tr.Dispose()
            trace(u"6 granice posle stila/traka: {0}".format(box))
            if box is None and keep is None and box0 is not None:
                box, src = box0, u"pre stila/traka – PROVERITI viewport"
                log.append(u"Upozorenje: {0} – prikaz je prazan posle promene stila/traka, korišćene "
                           u"granice pre promene.".format(name))
            if box is None:
                return ([u"GREŠKA: ne mogu da odredim granice prikaza preseka '{0}' (profil {1}).".format(
                    svname, name)] + errs + log)
            sec_box0[name] = (box, src)
            if keep is None:
                # ne sme da zalazi u prethodni prikaz u redu niti u prethodni red -> pomeri ga
                sx = (prev_right + gap - box[0]) if (prev_right is not None and box[0] < prev_right + gap) else 0.0
                sy = (row_limit - gap - box[3]) if (row_limit is not None and box[3] > row_limit - gap) else 0.0
                if sx or sy:
                    trace(u"6 pomeranje {0}: dx={1:.1f} dy={2:.1f}".format(name, sx, sy))
                    tr = db.TransactionManager.StartTransaction()
                    try:
                        tr.GetObject(svid, W).TransformBy(Matrix3d.Displacement(Vector3d(sx, sy, 0)))
                        tr.Commit()
                    finally:
                        tr.Dispose()
                    tr = db.TransactionManager.StartTransaction()
                    try:
                        nb, nsrc, nerr = view_extents(tr.GetObject(svid, R))
                    finally:
                        tr.Dispose()
                    box = nb if nb is not None else (box[0] + sx, box[1] + sy, box[2] + sx, box[3] + sy)
                    x, y = x + sx, y + sy
                left_over, top_over = x - box[0], box[3] - y   # koliko prikaz viri levo/gore od tačke umetanja
                prev_right = box[2]
                row_bottom = box[1] if row_bottom is None else min(row_bottom, box[1])
                n_in_row += 1
                if n_in_row >= CFG["PRIKAZA_U_REDU"]:
                    row_limit = row_bottom
                    x, y = base.X, row_bottom - gap - top_over
                    row_bottom, prev_right, n_in_row = None, None, 0
                else:
                    x = box[2] + gap + left_over
            sections.append({"name": name, "sta": sta, "slid": slid, "svid": svid})

        # ---------- 6b. konačne granice svih prikaza (trake se iscrtavaju tek posle izmena) ----------
        ed.Regen()
        tr = db.TransactionManager.StartTransaction()
        try:
            for sec in sections:
                sv = tr.GetObject(sec["svid"], R)
                box, src, errs = view_extents(sv)
                if box is None:
                    box, src = sec_box0[sec["name"]]
                log.append(u"{0}: prikaz '{1}' {2:.1f} x {3:.1f} m ({4})".format(
                    sec["name"], sv.Name, box[2] - box[0], box[3] - box[1], src))
                sec.update({"w": box[2] - box[0], "h": box[3] - box[1],
                            "cx": (box[0] + box[2]) / 2.0, "cy": (box[1] + box[3]) / 2.0})
        finally:
            tr.Dispose()
        trace(u"6b konačne granice izmerene")

        try:
            old_lcv = Application.GetSystemVariable("LAYOUTCREATEVIEWPORT")
            Application.SetSystemVariable("LAYOUTCREATEVIEWPORT", 0)
        except Exception:
            pass

        tr = db.TransactionManager.StartTransaction()
        try:
            trace(u"7 površine materijala")
            # ---------- 7. površine materijala ----------
            for sec in sections:
                sl = tr.GetObject(sec["slid"], R)
                areas = []
                for lg, mg, mname, lname in mat_keys:
                    a = 0.0
                    try:
                        msid, last = None, None
                        for arg in (mg, mname):   # API: (Guid liste, Guid materijala); rezerva: ime
                            try:
                                msid = sl.GetMaterialSectionId(lg, arg)
                                break
                            except Exception as e:
                                last = e
                        if msid is None:
                            raise last
                        if not msid.IsNull:
                            ms = tr.GetObject(msid, R)
                            sp = ms.SectionPoints
                            a = polygon_area([(sp[k].Location.X, sp[k].Location.Y) for k in range(sp.Count)])
                    except Exception as e:
                        log.append(u"Upozorenje: {0}/{1}: {2}".format(sec["name"], mname, e))
                    areas.append(a)
                sec["areas"] = areas
            if all(a == 0 for sec in sections for a in sec["areas"]):
                log.append(u"Upozorenje: sve površine materijala su 0 – ako je lista tek napravljena, "
                           u"pokrenite skriptu još jednom (Civil 3D tada preračuna materijale).")

            # ---------- 8. kontrola: zapreminske površine ----------
            control = []
            for sid in civdoc.GetSurfaceIds():
                s = tr.GetObject(sid, R)
                if isinstance(s, TinVolumeSurface):
                    if CFG["KONTROLNA_POVRSINA"] and s.Name != CFG["KONTROLNA_POVRSINA"]:
                        continue
                    vp_ = s.GetVolumeProperties()
                    control.append((s.Name, vp_.UnadjustedCutVolume, vp_.UnadjustedFillVolume))

            meta = {"alignment": aln_name, "slg": slg_name, "mlist": mlist_used,
                    "date": datetime.date.today().strftime("%d.%m.%Y"), "control": control}

            trace(u"9 lejauti")
            # ---------- 9. lejauti ----------
            lm = LayoutManager.Current
            lm.CurrentLayout = "Model"
            if CFG["OBRISI_STARE_LEJAUTE"]:
                ld = tr.GetObject(db.LayoutDictionaryId, R)
                old = [e.Key for e in ld if e.Key.startswith(CFG["PREFIKS_LEJAUTA"])]
                for n in old:
                    lm.DeleteLayout(n)

            cv = CivilCanvas(db, tr, lm, locals_=dict(
                OpenMode=OpenMode, Line=Line, Polyline=Polyline, MText=MText, Viewport=Viewport,
                AttachmentPoint=AttachmentPoint, PlotSettings=PlotSettings,
                PlotSettingsValidator=PlotSettingsValidator, PlotPaperUnit=PlotPaperUnit,
                PlotRotation=PlotRotation, PlotType=PlotType, StdScaleType=StdScaleType,
                LayerTableRecord=LayerTableRecord, TextStyleTableRecord=TextStyleTableRecord,
                BlockReference=BlockReference, Point2d=Point2d, Point3d=Point3d,
                Vector3d=Vector3d, Color=Color, ColorMethod=ColorMethod,
                FontDescriptor=FontDescriptor), log=log)
            S, names, totals = draw_all(cv, sections, mats, meta)
            if names:
                lm.CurrentLayout = names[0]
            tr.Commit()
            trace(u"KRAJ")
        finally:
            tr.Dispose()
    finally:
        if old_lcv is not None:
            try:
                Application.SetSystemVariable("LAYOUTCREATEVIEWPORT", old_lcv)
            except Exception:
                pass
        lock.Dispose()

    out = [u"Osovina: {0}, grupa: {1}, profila: {2}, razmera: 1:{3}".format(
        aln_name, slg_name, len(sections), S)]
    for i, m in enumerate(mats):
        out.append(u"Ukupno {0}: {1} m³".format(m, fmt(totals[i])))
    out.append(u"Napravljeno lejauta: {0}".format(len(names)))
    return out + names + log


def _box_ok(b):
    if b is None:
        return False
    for v in b:
        if v != v or abs(v) > 1e12:   # NaN ili "prazne" granice (1e20)
            return False
    return (b[2] - b[0]) > 0.5 and (b[3] - b[1]) > 0.5


def _ext_box(e):
    return (e.MinPoint.X, e.MinPoint.Y, e.MaxPoint.X, e.MaxPoint.Y)


def _explode_box(sv):
    """Stvarne granice svega što prikaz crta (mreža, kote, trake, oznake): eksplodira se u memoriji,
    crtež se ne menja."""
    from Autodesk.AutoCAD.DatabaseServices import DBObjectCollection
    coll = DBObjectCollection()
    sv.Explode(coll)
    b = None
    try:
        for o in coll:
            try:
                e = o.GeometricExtents
            except Exception:
                continue
            eb = _ext_box(e)
            if not _box_ok((eb[0], eb[1], eb[0] + 1, eb[1] + 1)) or not _box_ok((eb[2], eb[3], eb[2] + 1, eb[3] + 1)):
                continue
            b = eb if b is None else (min(b[0], eb[0]), min(b[1], eb[1]), max(b[2], eb[2]), max(b[3], eb[3]))
    finally:
        for o in coll:
            try:
                o.Dispose()
            except Exception:
                pass
    return b


def view_extents(sv):
    """Granice prikaza preseka u modelu: Explode (sve) -> GeometricExtents (+ margine) -> Bounds -> ofset/kota.
    Vraća (box, izvor, lista grešaka)."""
    errs = []
    try:
        b = _explode_box(sv)
        if _box_ok(b):
            m = CFG["MARGINA_PRIKAZA"]
            return (b[0] - m, b[1] - m, b[2] + m, b[3] + m), u"Explode", errs
        errs.append(u"Explode neispravan: {0}".format(b))
    except Exception as e:
        errs.append(u"Explode: {0}".format(e))
    try:
        b = _ext_box(sv.GeometricExtents)
        if _box_ok(b):
            return b, u"GeometricExtents", errs
        errs.append(u"GeometricExtents neispravan: {0}".format(b))
    except Exception as e:
        errs.append(u"GeometricExtents: {0}".format(e))
    try:
        e = sv.Bounds
        if e is not None:
            e = getattr(e, "Value", e)
            b = _ext_box(e)
            if _box_ok(b):
                return b, u"Bounds", errs
            errs.append(u"Bounds neispravan: {0}".format(b))
        else:
            errs.append(u"Bounds = None")
    except Exception as e:
        errs.append(u"Bounds: {0}".format(e))
    try:
        def xy(off, el):
            r = sv.FindXYAtOffsetAndElevation(off, el, 0.0, 0.0)
            nums = [v for v in (r if isinstance(r, tuple) else (r,)) if isinstance(v, float)]
            return nums[-2], nums[-1]
        x0, y0 = xy(sv.OffsetMin, sv.ElevationMin)
        x1, y1 = xy(sv.OffsetMax, sv.ElevationMax)
        h = abs(y1 - y0)
        b = (min(x0, x1), min(y0, y1) - 0.6 * h, max(x0, x1), max(y0, y1) + 0.05 * h)  # + rezerva za trake
        if _box_ok(b):
            return b, u"ofset/kota (procena traka)", errs
        errs.append(u"ofset/kota neispravno: {0}".format(b))
    except Exception as e:
        errs.append(u"ofset/kota: {0}".format(e))
    return None, None, errs


class CivilCanvas(object):
    ATT = {"TL": "TopLeft", "TC": "TopCenter", "TR": "TopRight", "ML": "MiddleLeft",
           "MC": "MiddleCenter", "MR": "MiddleRight", "BL": "BottomLeft"}
    LAYERS = {"DOK-OKVIR": (7, True), "DOK-TABELA": (8, True), "DOK-TEKST": (7, True),
              "DOK-VIEWPORT": (4, False)}

    def __init__(self, db, tr, lm, locals_, log):
        self.db, self.tr, self.lm, self.k, self.log = db, tr, lm, locals_, log
        self.btr = None
        k = self.k
        lt = tr.GetObject(db.LayerTableId, k["OpenMode"].ForWrite)
        for name, (aci, plot) in self.LAYERS.items():
            if not lt.Has(name):
                r = k["LayerTableRecord"]()
                r.Name = name
                r.Color = k["Color"].FromColorIndex(k["ColorMethod"].ByAci, aci)
                r.IsPlottable = plot
                lt.Add(r)
                tr.AddNewlyCreatedDBObject(r, True)
        tst = tr.GetObject(db.TextStyleTableId, k["OpenMode"].ForWrite)
        if not tst.Has("DOK-Arial"):
            r = k["TextStyleTableRecord"]()
            r.Name = "DOK-Arial"
            r.Font = k["FontDescriptor"]("Arial", False, False, 0, 0)
            tst.Add(r)
            tr.AddNewlyCreatedDBObject(r, True)
        self.style_id = tst.get_Item("DOK-Arial")

    def begin_sheet(self, name):
        k, tr = self.k, self.tr
        lid = self.lm.CreateLayout(name)
        lay = tr.GetObject(lid, k["OpenMode"].ForWrite)
        try:
            psv = k["PlotSettingsValidator"].Current
            ps = k["PlotSettings"](False)
            ps.CopyFrom(lay)
            psv.SetPlotConfigurationName(ps, CFG["UREDJAJ"], None)
            psv.RefreshLists(ps)
            psv.SetCanonicalMediaName(ps, CFG["FORMAT_PAPIRA"])
            psv.SetPlotPaperUnits(ps, k["PlotPaperUnit"].Millimeters)
            psv.SetPlotType(ps, k["PlotType"].Layout)
            psv.SetUseStandardScale(ps, True)
            psv.SetStdScaleType(ps, k["StdScaleType"].StdScale1To1)
            psv.SetPlotRotation(ps, k["PlotRotation"].Degrees000)
            lay.CopyFrom(ps)
        except Exception as e:
            self.log.append(u"Upozorenje: podešavanje štampe za '{0}': {1}".format(name, e))
        self.lm.CurrentLayout = name
        self.btr = tr.GetObject(lay.BlockTableRecordId, k["OpenMode"].ForWrite)

    def _add(self, ent, layer, color=None):
        ent.SetDatabaseDefaults(self.db)
        ent.Layer = layer
        if color is not None:
            ent.ColorIndex = color
        self.btr.AppendEntity(ent)
        self.tr.AddNewlyCreatedDBObject(ent, True)
        return ent

    def line(self, x1, y1, x2, y2, layer):
        P = self.k["Point3d"]
        self._add(self.k["Line"](P(x1, y1, 0), P(x2, y2, 0)), layer)

    def rect(self, x0, y0, x1, y1, layer):
        P2 = self.k["Point2d"]
        pl = self.k["Polyline"]()
        for i, (x, y) in enumerate([(x0, y0), (x1, y0), (x1, y1), (x0, y1)]):
            pl.AddVertexAt(i, P2(x, y), 0, 0, 0)
        pl.Closed = True
        self._add(pl, layer)

    def text(self, x, y, s, h, attach="TL", width=0, layer="DOK-TEKST", color=None):
        mt = self.k["MText"]()
        mt.SetDatabaseDefaults(self.db)
        mt.Location = self.k["Point3d"](x, y, 0)
        mt.TextStyleId = self.style_id
        mt.TextHeight = h
        mt.Attachment = getattr(self.k["AttachmentPoint"], self.ATT[attach])
        if width:
            mt.Width = width
        s = s.replace(u"\\", u"\\\\").replace(u"{", u"\\{").replace(u"}", u"\\}")
        mt.Contents = s.replace(u"\n", u"\\P")
        self._add(mt, layer, color)

    def viewport(self, box, sec):
        k = self.k
        if not _box_ok(box):
            raise ValueError(u"Neispravna veličina viewporta za profil {0}: {1}".format(sec["name"], box))
        vp = k["Viewport"]()
        vp.SetDatabaseDefaults(self.db)
        vp.CenterPoint = k["Point3d"]((box[0] + box[2]) / 2.0, (box[1] + box[3]) / 2.0, 0)
        vp.Width = box[2] - box[0]
        vp.Height = box[3] - box[1]
        vp.Layer = "DOK-VIEWPORT"
        self.btr.AppendEntity(vp)
        self.tr.AddNewlyCreatedDBObject(vp, True)
        vp.ViewDirection = k["Vector3d"].ZAxis
        vp.ViewTarget = k["Point3d"](sec["cx"], sec["cy"], 0)
        vp.ViewCenter = k["Point2d"](0, 0)
        vp.CustomScale = 1000.0 / sec["scale"]
        vp.On = True
        vp.Locked = True

    def insert_block(self, name):
        k, tr = self.k, self.tr
        bt = tr.GetObject(self.db.BlockTableId, k["OpenMode"].ForRead)
        if not bt.Has(name):
            self.log.append(u"Upozorenje: blok '{0}' ne postoji – crta se jednostavan okvir.".format(name))
            return False
        br = k["BlockReference"](k["Point3d"](0, 0, 0), bt.get_Item(name))
        self._add(br, "DOK-OKVIR")
        return True


# =====================================================================
# ULAZ / IZLAZ ZA DYNAMO
# =====================================================================
if "__DOK_TEST__" not in globals():
    import traceback
    try:
        _in = IN  # noqa: F821  (Dynamo ulaz)
    except NameError:
        _in = [u""]
    try:
        OUT = run_civil(_in)
    except Exception:
        OUT = [u"GREŠKA:", traceback.format_exc()]
# ----------------------------------------
rezultat = Watch(dokaznica_iskopa)  # graph output
