# Dynamo graph GradingFromLayer.dyn (Dynamo 2.17.1.5325)
# Footprint line -> polyline -> feature line -> daylight grading -> TIN surface. All prompts on the Civil 3D command line. Run in MANUAL mode.

grading_from_layer = Python()  # CPython3; unwired: IN[0]
# ---------- grading_from_layer.python (523 lines) ----------
# ============================================================================
#  GRADING FROM LAYER  —  Dynamo for Civil 3D  (Python node, CPython3 engine)
# ============================================================================
#  Workflow (all prompts happen on the Civil 3D command line):
#    1. Pick a LINE  -> its layer becomes the footprint layer
#       (all LINEs on that layer are chained end-to-end into one polyline;
#        if you pick a POLYLINE instead, it is used directly)
#    2. A 2D polyline footprint is created
#    3. You select the target TIN surface
#    4. You enter the design elevation of the pad / footprint
#    5. A feature line is created from the polyline (in site "Grading Site")
#    6. You enter cut slope, fill slope (H : 1V), sample step, max projection
#       distance, and pick a point on the side you want to grade towards
#    7. The daylight line is computed by projecting from the feature line at
#       your slopes until it intersects the target surface
#    8. A new TIN surface is created from footprint + daylight + slope lines
#
#  NOTE: Autodesk does NOT expose grading-object creation in any public API,
#  so this script reproduces the grading geometrically (daylight projection).
#  The result is a daylight 3D-polyline, slope projection lines, and a TIN
#  surface — the same end product as Grading Creation Tools + auto surface.
#
#  Run Dynamo in MANUAL run mode. After clicking Run, switch to the Civil 3D
#  window and answer the command-line prompts.
# ============================================================================

import clr
import math
import traceback

clr.AddReference('AcMgd')
clr.AddReference('AcCoreMgd')
clr.AddReference('AcDbMgd')
clr.AddReference('AecBaseMgd')
clr.AddReference('AeccDbMgd')

from Autodesk.AutoCAD.ApplicationServices import Application
from Autodesk.AutoCAD.DatabaseServices import (
    OpenMode, BlockTable, BlockTableRecord, Line, Polyline, Polyline3d,
    Poly3dType, ObjectIdCollection, LayerTableRecord)
from Autodesk.AutoCAD.EditorInput import (
    PromptEntityOptions, PromptDoubleOptions, PromptPointOptions,
    PromptStringOptions, PromptStatus)
from Autodesk.AutoCAD.Geometry import (
    Point2d, Point3d, Point3dCollection)
from Autodesk.Civil.ApplicationServices import CivilApplication
from Autodesk.Civil.DatabaseServices import FeatureLine, TinSurface, Site

try:
    from Autodesk.Civil import SurfaceBoundaryType
    HAS_BND = True
except Exception:
    HAS_BND = False

TOL = 0.01          # connection tolerance for chaining lines (drawing units)
SITE_NAME = "Grading Site"
LAY_FOOT = "C-GRAD-FOOTPRINT"
LAY_DAY = "C-GRAD-DAYLIGHT"
LAY_SLOPE = "C-GRAD-SLOPES"

adoc = Application.DocumentManager.MdiActiveDocument
ed = adoc.Editor
db = adoc.Database
civdoc = CivilApplication.ActiveDocument

log = []


# ----------------------------------------------------------- prompt helpers
def get_double(msg, default, allow_zero=False):
    o = PromptDoubleOptions(msg)
    o.DefaultValue = default
    o.UseDefaultValue = True
    o.AllowNegative = False
    o.AllowZero = allow_zero
    r = ed.GetDouble(o)
    return r.Value if r.Status == PromptStatus.OK else None


def get_string(msg, default):
    o = PromptStringOptions(msg)
    o.DefaultValue = default
    o.UseDefaultValue = True
    o.AllowSpaces = False
    r = ed.GetString(o)
    if r.Status != PromptStatus.OK:
        return None
    return r.StringResult if r.StringResult else default


# ----------------------------------------------------------- geometry helpers
def close_pts(a, b, tol=TOL):
    return (a[0] - b[0]) ** 2 + (a[1] - b[1]) ** 2 <= tol * tol


def chain_lines(segs, start_idx):
    """Chain (start,end) segments into one ordered point list."""
    chain = [segs[start_idx][0], segs[start_idx][1]]
    used = set([start_idx])
    extended = True
    while extended:
        extended = False
        for j in range(len(segs)):
            if j in used:
                continue
            a, b = segs[j]
            if close_pts(chain[-1], a):
                chain.append(b); used.add(j); extended = True
            elif close_pts(chain[-1], b):
                chain.append(a); used.add(j); extended = True
            elif close_pts(chain[0], a):
                chain.insert(0, b); used.add(j); extended = True
            elif close_pts(chain[0], b):
                chain.insert(0, a); used.add(j); extended = True
    closed = len(chain) > 3 and close_pts(chain[0], chain[-1])
    if closed:
        chain = chain[:-1]
    return chain, closed, len(used)


def cum_lengths(pts, closed):
    n = len(pts)
    cl = [0.0]
    m = n if closed else n - 1
    for i in range(m):
        x1, y1 = pts[i]
        x2, y2 = pts[(i + 1) % n]
        cl.append(cl[-1] + math.hypot(x2 - x1, y2 - y1))
    return cl  # cl[-1] == total length


def point_tangent_at(pts, closed, cl, d):
    """XY point + unit tangent at distance d along the footprint."""
    n = len(pts)
    total = cl[-1]
    d = max(0.0, min(d, total - 1e-9))
    for i in range(len(cl) - 1):
        if cl[i] <= d <= cl[i + 1]:
            x1, y1 = pts[i]
            x2, y2 = pts[(i + 1) % n]
            seg = cl[i + 1] - cl[i]
            t = 0.0 if seg == 0 else (d - cl[i]) / seg
            dx, dy = x2 - x1, y2 - y1
            ln = math.hypot(dx, dy)
            if ln == 0:
                continue
            return (x1 + t * dx, y1 + t * dy, dx / ln, dy / ln)
    x1, y1 = pts[0]
    x2, y2 = pts[1 % n]
    dx, dy = x2 - x1, y2 - y1
    ln = math.hypot(dx, dy) or 1.0
    return (x1, y1, dx / ln, dy / ln)


def side_sign(pts, closed, px, py):
    """+1 / -1 depending on which side of the footprint the pick point lies."""
    n = len(pts)
    m = n if closed else n - 1
    best = None
    for i in range(m):
        x1, y1 = pts[i]
        x2, y2 = pts[(i + 1) % n]
        dx, dy = x2 - x1, y2 - y1
        L2 = dx * dx + dy * dy
        if L2 == 0:
            continue
        t = max(0.0, min(1.0, ((px - x1) * dx + (py - y1) * dy) / L2))
        cx, cy = x1 + t * dx, y1 + t * dy
        d2 = (px - cx) ** 2 + (py - cy) ** 2
        if best is None or d2 < best[0]:
            best = (d2, dx * (py - cy) - dy * (px - cx))
    return 1 if (best and best[1] > 0) else -1


def ensure_layer(t, name):
    lt = t.GetObject(db.LayerTableId, OpenMode.ForRead)
    if not lt.Has(name):
        lt.UpgradeOpen()
        ltr = LayerTableRecord()
        ltr.Name = name
        lt.Add(ltr)
        t.AddNewlyCreatedDBObject(ltr, True)
    return name


def unique_surface_name(t, base):
    names = set()
    try:
        for sid in civdoc.GetSurfaceIds():
            s = t.GetObject(sid, OpenMode.ForRead)
            names.add(s.Name)
    except Exception:
        pass
    if base not in names:
        return base
    i = 1
    while ("%s_%d" % (base, i)) in names:
        i += 1
    return "%s_%d" % (base, i)


# ============================================================ PHASE 1: INPUT
result_msg = ""
try:
    # ---- 1. pick footprint line --------------------------------------------
    peo = PromptEntityOptions("\nSelect a LINE or POLYLINE on the footprint layer: ")
    peo.SetRejectMessage("\nMust be a Line or Polyline.")
    peo.AddAllowedClass(clr.GetClrType(Line), False)
    peo.AddAllowedClass(clr.GetClrType(Polyline), False)
    sel = ed.GetEntity(peo)
    if sel.Status != PromptStatus.OK:
        raise Exception("Cancelled at footprint selection.")

    pts = []
    closed = False
    layer_name = ""
    n_chained = 1

    t = db.TransactionManager.StartTransaction()
    try:
        ent = t.GetObject(sel.ObjectId, OpenMode.ForRead)
        layer_name = ent.Layer
        if isinstance(ent, Polyline):
            for i in range(ent.NumberOfVertices):
                p = ent.GetPoint2dAt(i)
                pts.append((p.X, p.Y))
            closed = bool(ent.Closed)
        else:
            # collect ALL lines on that layer and chain them
            segs = []
            picked_idx = 0
            bt = t.GetObject(db.BlockTableId, OpenMode.ForRead)
            ms = t.GetObject(bt[BlockTableRecord.ModelSpace], OpenMode.ForRead)
            for oid in ms:
                try:
                    obj = t.GetObject(oid, OpenMode.ForRead)
                except Exception:
                    continue
                if isinstance(obj, Line) and obj.Layer == layer_name:
                    if oid == sel.ObjectId:
                        picked_idx = len(segs)
                    segs.append(((obj.StartPoint.X, obj.StartPoint.Y),
                                 (obj.EndPoint.X, obj.EndPoint.Y)))
            pts, closed, n_chained = chain_lines(segs, picked_idx)
        t.Commit()
    finally:
        t.Dispose()

    if len(pts) < 2:
        raise Exception("Could not build a footprint from layer '%s'." % layer_name)
    log.append("Footprint: %d vertices (%s), %d line(s) chained, layer '%s'."
               % (len(pts), "closed" if closed else "open", n_chained, layer_name))

    # ---- 2. select target surface ------------------------------------------
    pso = PromptEntityOptions("\nSelect target TIN surface: ")
    pso.SetRejectMessage("\nMust be a TIN surface.")
    pso.AddAllowedClass(clr.GetClrType(TinSurface), False)
    ssel = ed.GetEntity(pso)
    if ssel.Status != PromptStatus.OK:
        raise Exception("Cancelled at surface selection.")
    target_surf_id = ssel.ObjectId

    # default pad elevation = surface elevation at first footprint vertex
    def_elev = 0.0
    t = db.TransactionManager.StartTransaction()
    try:
        tin = t.GetObject(target_surf_id, OpenMode.ForRead)
        try:
            def_elev = round(tin.FindElevationAtXY(pts[0][0], pts[0][1]), 2)
        except Exception:
            def_elev = 0.0
        t.Commit()
    finally:
        t.Dispose()

    # ---- 3. grading parameters ---------------------------------------------
    elev = get_double("\nDesign elevation of feature line <%s>: " % def_elev,
                      def_elev, allow_zero=True)
    if elev is None:
        raise Exception("Cancelled at elevation.")

    cut_slope = get_double("\nCUT slope, H per 1V (e.g. 2 = 2:1) <2.0>: ", 2.0)
    if cut_slope is None:
        raise Exception("Cancelled at cut slope.")

    fill_slope = get_double("\nFILL slope, H per 1V (e.g. 3 = 3:1) <3.0>: ", 3.0)
    if fill_slope is None:
        raise Exception("Cancelled at fill slope.")

    step = get_double("\nSample step along footprint <2.0>: ", 2.0)
    if step is None:
        raise Exception("Cancelled at step.")

    max_d = get_double("\nMaximum projection distance <100.0>: ", 100.0)
    if max_d is None:
        raise Exception("Cancelled at max distance.")

    surf_name = get_string("\nName for new grading surface <GRADING-SURF>: ",
                           "GRADING-SURF")
    if surf_name is None:
        raise Exception("Cancelled at surface name.")

    ppo = PromptPointOptions("\nPick a point on the side to grade towards (outside): ")
    pres = ed.GetPoint(ppo)
    if pres.Status != PromptStatus.OK:
        raise Exception("Cancelled at side pick.")
    sgn = side_sign(pts, closed, pres.Value.X, pres.Value.Y)

    # ========================================================= PHASE 2: BUILD
    cl = cum_lengths(pts, closed)
    total_len = cl[-1]
    if total_len <= 0:
        raise Exception("Zero-length footprint.")

    # sample distances: regular step + just before/after each vertex (corners)
    dset = set()
    d = 0.0
    while d < total_len:
        dset.add(round(d, 4))
        d += step
    if not closed:
        dset.add(round(total_len - 1e-6, 4))
    eps = min(0.05, step / 10.0)
    for cd in cl[1:-1]:
        dset.add(round(max(0.0, cd - eps), 4))
        dset.add(round(min(total_len - 1e-6, cd + eps), 4))
    dlist = sorted(dset)

    dlock = adoc.LockDocument()
    try:
        t = db.TransactionManager.StartTransaction()
        try:
            ensure_layer(t, LAY_FOOT)
            ensure_layer(t, LAY_DAY)
            ensure_layer(t, LAY_SLOPE)

            bt = t.GetObject(db.BlockTableId, OpenMode.ForRead)
            ms = t.GetObject(bt[BlockTableRecord.ModelSpace], OpenMode.ForWrite)

            # ---- polyline from the chained lines ----
            pl = Polyline()
            for i, (x, y) in enumerate(pts):
                pl.AddVertexAt(i, Point2d(x, y), 0.0, 0.0, 0.0)
            pl.Closed = closed
            pl.Elevation = elev
            pl.Layer = LAY_FOOT
            pl_id = ms.AppendEntity(pl)
            t.AddNewlyCreatedDBObject(pl, True)
            log.append("Polyline created at elevation %.3f." % elev)

            # ---- site (find or create) ----
            site_id = None
            try:
                for sid in civdoc.GetSiteIds():
                    s = t.GetObject(sid, OpenMode.ForRead)
                    if s.Name == SITE_NAME:
                        site_id = sid
                        break
            except Exception:
                pass
            if site_id is None:
                try:
                    site_id = Site.Create(civdoc, SITE_NAME)
                    log.append("Site '%s' created." % SITE_NAME)
                except Exception:
                    site_id = None

            # ---- feature line ----
            fl_name = "FL_" + surf_name
            try:
                if site_id is not None:
                    fl_id = FeatureLine.Create(fl_name, pl_id, site_id)
                else:
                    fl_id = FeatureLine.Create(fl_name, pl_id)
                log.append("Feature line '%s' created." % fl_name)
            except Exception as ex:
                raise Exception("Feature line creation failed: %s" % ex)

            # ---- daylight computation ----
            tin = t.GetObject(target_surf_id, OpenMode.ForRead)

            def surf_z(x, y):
                try:
                    return tin.FindElevationAtXY(x, y)
                except Exception:
                    return None

            day_pts = []          # daylight points (x, y, z)
            proj_pairs = []       # (foot point 3d, daylight point 3d)
            skipped = 0
            march = max(0.25, min(1.0, max_d / 200.0))

            for d in dlist:
                x0, y0, tx, ty = point_tangent_at(pts, closed, cl, d)
                nx, ny = -ty * sgn, tx * sgn
                s0 = surf_z(x0, y0)
                if s0 is None:
                    skipped += 1
                    continue
                if elev >= s0:
                    slope, zdir = fill_slope, -1.0   # fill: project down
                else:
                    slope, zdir = cut_slope, 1.0     # cut: project up

                def fval(dd):
                    sz = surf_z(x0 + nx * dd, y0 + ny * dd)
                    if sz is None:
                        return None
                    return (elev + zdir * dd / slope) - sz

                f0 = elev - s0
                lo, flo = 0.0, f0
                hit = None
                dd = march
                while dd <= max_d:
                    fd = fval(dd)
                    if fd is None:
                        break                      # left surface extents
                    if (flo <= 0 <= fd) or (fd <= 0 <= flo):
                        # bisection refine
                        a, b, fa = lo, dd, flo
                        for _ in range(40):
                            m = 0.5 * (a + b)
                            fm = fval(m)
                            if fm is None:
                                break
                            if (fa <= 0 <= fm) or (fm <= 0 <= fa):
                                b = m
                            else:
                                a, fa = m, fm
                        hit = 0.5 * (a + b)
                        break
                    lo, flo = dd, fd
                    dd += march

                if hit is None or hit < 1e-6:
                    skipped += 1
                    continue
                zx = elev + zdir * hit / slope
                fx, fy = x0 + nx * hit, y0 + ny * hit
                day_pts.append((fx, fy, zx))
                proj_pairs.append(((x0, y0, elev), (fx, fy, zx)))

            if len(day_pts) < 2:
                raise Exception("Daylight not found (%d samples skipped). "
                                "Check side pick, slopes, elevation and max "
                                "distance vs. surface extents." % skipped)
            log.append("Daylight computed: %d points (%d samples skipped)."
                       % (len(day_pts), skipped))

            # ---- daylight 3D polyline ----
            p3c = Point3dCollection()
            for (x, y, z) in day_pts:
                p3c.Add(Point3d(x, y, z))
            day_pl = Polyline3d(Poly3dType.SimplePoly, p3c, closed)
            day_pl.Layer = LAY_DAY
            day_id = ms.AppendEntity(day_pl)
            t.AddNewlyCreatedDBObject(day_pl, True)

            # ---- slope projection lines (visual + breaklines) ----
            slope_ids = ObjectIdCollection()
            for (a, b) in proj_pairs:
                ln = Line(Point3d(a[0], a[1], a[2]), Point3d(b[0], b[1], b[2]))
                ln.Layer = LAY_SLOPE
                lid = ms.AppendEntity(ln)
                t.AddNewlyCreatedDBObject(ln, True)
                slope_ids.Add(lid)

            # ---- new TIN surface ----
            new_name = unique_surface_name(t, surf_name)
            new_surf_id = TinSurface.Create(db, new_name)
            new_tin = t.GetObject(new_surf_id, OpenMode.ForWrite)

            brk = ObjectIdCollection()
            brk.Add(fl_id)
            brk.Add(day_id)
            try:
                new_tin.BreaklinesDefinition.AddStandardBreaklines(
                    brk, 1.0, 0.0, 0.0, 0.0)
                if slope_ids.Count <= 800:
                    new_tin.BreaklinesDefinition.AddStandardBreaklines(
                        slope_ids, 1.0, 0.0, 0.0, 0.0)
            except Exception:
                new_tin.BreaklinesDefinition.AddStandardBreaklines(
                    brk, 1.0, 100.0, 0.0, 0.0)

            if closed and HAS_BND:
                try:
                    bnd = ObjectIdCollection()
                    bnd.Add(day_id)
                    new_tin.BoundariesDefinition.AddBoundaries(
                        bnd, 1.0, SurfaceBoundaryType.Outer, True)
                except Exception:
                    log.append("Note: outer boundary could not be added.")

            try:
                new_tin.Rebuild()
            except Exception:
                pass

            log.append("Surface '%s' created." % new_name)
            t.Commit()
        except Exception:
            t.Abort()
            raise
        finally:
            t.Dispose()
    finally:
        dlock.Dispose()

    ed.Regen()
    result_msg = "DONE\n" + "\n".join(log)
    ed.WriteMessage("\n" + result_msg + "\n")

except Exception as e:
    result_msg = "FAILED: %s\n%s\n--- log ---\n%s" % (
        e, traceback.format_exc(), "\n".join(log))
    try:
        ed.WriteMessage("\n" + str(e) + "\n")
    except Exception:
        pass

OUT = result_msg
# ----------------------------------------
